# Dynamo graph Calculate Room Occupancy Load.dyn (Dynamo 2.13.0.3137)
# author: Autodesk
# This workflow will report information about the selected room and its occupancy load based on the allowable number of occupants per unit area.

# group: Room Occupancy Load
# Calculate based on selection and area/occupant
# note: See graph properties for more information

# group: Room Selection
# Select room to run calculation on
select_a_room = DSModelElementByCategorySelection(index=518)  # nothing selected; graph input

name = Room.Name(room=select_a_room)

# group: Area Per Occupant
# Enter area allowed per occupant in project units (Ft² or M²)
allowable_area_per_occupant = DoubleInput(15)  # graph input

# group: Calculations
# Calculate occupancy load given area and allowable area per occupant
string = StringInput("Area")
getParameterValueByName = Element.GetParameterValueByName(element=select_a_room, parameterName=string)
div = getParameterValueByName / allowable_area_per_occupant
ceiling = Math.Ceiling(number=div)

# group: Get Units
# Retrieve units from file for output.
getProjectUnits = Python(IN[0]=getParameterValueByName)  # CPython3
# ---------- getProjectUnits.python (22 lines) ----------
# Import DocumentManager and TransactionManager
import clr
clr.AddReference("RevitServices")
import RevitServices
from RevitServices.Persistence import DocumentManager
doc = DocumentManager.Instance.CurrentDBDocument

# Import RevitAPI
clr.AddReference("RevitAPI")
import Autodesk
from Autodesk.Revit.DB import *


# Set up inputs
value = IN[0]

# Execute definition
projectUnits = Document.GetUnits(doc).GetFormatOptions(SpecTypeId.Area).GetUnitTypeId()
displayUnit = LabelUtils.GetLabelForUnit(projectUnits)

# Assign your output to the OUT variable
OUT = displayUnit
# ----------------------------------------

# group: Build Output
# combine strings and return output for Dynamo Player. By using addition in a code block we convert numbers to string automatically
code_block = CodeBlock(roomName=name, area=getParameterValueByName, occupancyLoad=ceiling, units=getProjectUnits)
# ---------- code_block.designscript (13 lines) ----------
//declare a few variables to combine for output
roomName;
area;
occupancyLoad;
//build output
//first line prefix + name + return line
"Room Name: " + roomName + "\n" +
//second line prefix + area + return line
"Area: ~" + area + " " + units+ "\n" +
//blank line
"\n"+
//third line prefix + occupancy load
"Occupancy Load: " + occupancyLoad + " ";
# ----------------------------------------
calculation_results = Watch(code_block.out3)  # graph output
