# Dynamo graph Calculate Total Length of Selected Lines.dyn (Dynamo 2.13.0.3135)
# author: Autodesk
# This workflow allows you to select multiple detail or model lines and find out their total length. By toggling the Boolean input to True, current project units will be used. When set to False, Revit's internal units of Feet will be used to display total length.

# group: Calculate Length
# Calculate Length of Selected Lines
# note: See graph properties for more information

# group: Selection
# Model/Detail Line Selection
select_detail_and_model_lines = DSModelElementsByCategorySelection("308df9b2-0ebc-4ee6-ad61-c887be6de851-00069dba,308df9b2-0ebc-4ee6-ad61-c887be6de851-00069dd3,308df9b2-0ebc-4ee6-ad61-c887be6de851-00069de3")  # 3 picked in the model; graph input

# group: Get Lengths and Sum
# Get Length parameter from selected detail and model curves and sum up
string = StringInput("Length")
getParameterValueByName = Element.GetParameterValueByName(element=select_detail_and_model_lines, parameterName=string)
sum = Math.Sum(values=getParameterValueByName)

# group: Count Lines
# Count lines for output
count = List.Count(list=getParameterValueByName)

# group: Get Units
# Retrieve units from file for output.
toFeet = Python(IN[0]=sum)  # "ConvertLength.ToFeet"; IronPython2
# ---------- toFeet.python (26 lines) ----------
# Import DocumentManager and TransactionManager
import clr
clr.AddReference("RevitServices")
import RevitServices
from RevitServices.Persistence import DocumentManager
doc = DocumentManager.Instance.CurrentDBDocument

# Import RevitAPI
clr.AddReference("RevitAPI")
import Autodesk
from Autodesk.Revit.DB import *

# Add reference to IronPython Lib folder
import sys
pyt_path = r'C:\Program Files (x86)\IronPython 2.7\Lib'
sys.path.append(pyt_path)

# Set up inputs
value = IN[0]

# Execute definition
projectUnits = Document.GetUnits(doc).GetFormatOptions(SpecTypeId.Length).GetUnitTypeId()
displayUnit = LabelUtils.GetLabelForUnit(projectUnits)

# Assign your output to the OUT variable
OUT = displayUnit
# ----------------------------------------

# group: Build Output
# combine strings and return output for Dynamo Player. By using addition in a code block we convert numbers to string automatically
code_block = CodeBlock(curveCount=count, totalLength=sum, units=toFeet)
# ---------- code_block.designscript (9 lines) ----------
//declare a few variables to combine for output
curveCount;
totalLength;
units;
//build output
//first line prefix + count + return line
"Selected Curves: " + curveCount + "\n" +
//second line prefix + total length + space + units
"Total Length: " + totalLength + " " + units;
# ----------------------------------------
calculation_results = Watch(code_block.out3)  # graph output
